# Grasshopper definition CodeExample_FirstWorkshop_Coon'sPatch.gh (Grasshopper 0.9.76)
# Copyright: All rights reserved
# plug-ins: MeshEdit Components, Python Interpreter

crv_u1 = Curve(reparameterize(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))
crv_u2 = Curve(reparameterize(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))
crv_v1 = Curve(reparameterize(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))
crv_v2 = Curve(reparameterize(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))
u_n = Number(Slider(14, range=0..100))
v_n = Number(Slider(8, range=0..100))
c_script = CSharpScript(u1=crv_u1, u2=crv_u2, v1=crv_v1, v2=crv_v2, uN=u_n, vN=v_n)  # -> out, A, B, C; inputs u1: Curve, u2: Curve, v1: Curve, v2: Curve, uN: Int32, vN: Int32
# ---------- c_script: C# ----------
    Point3d[] vertices = new Point3d[4];
    vertices[0] = u1.PointAtStart;
    vertices[1] = v1.PointAtStart;
    vertices[2] = u2.PointAtStart;
    vertices[3] = v2.PointAtStart;
    Point3dList VList = new Point3dList(vertices);
    VList.Sort();
    vertices = VList.ToArray();
    BoundingBox BB = new BoundingBox(vertices);
    BoundingBox BU1 = u1.GetBoundingBox(false);
    BoundingBox BU2 = u2.GetBoundingBox(false);
    BoundingBox BV1 = v1.GetBoundingBox(false);
    BoundingBox BV2 = v2.GetBoundingBox(false);
    BB.Union(BU1);
    BB.Union(BU2);
    BB.Union(BV1);
    BB.Union(BV2);
    B = BB;
    Vector3d Diagonal = BB.Diagonal;
    double USize = Diagonal.X / (double) uN;
    double VSize = Diagonal.Y / (double) vN;
    Print(string.Format("{0},{1}", USize.ToString(), VSize.ToString()));

    List<Plane> XCutPlanes = new List<Plane>();
    List<Plane> YCutPlanes = new List<Plane>();
    Plane PZX = Plane.WorldZX;
    PZX.Origin = vertices[0];
    Plane PYZ = Plane.WorldYZ;
    PYZ.Origin = vertices[0];
    Vector3d XMove = new Vector3d(USize, 0, 0);
    Vector3d YMove = new Vector3d(0, VSize, 0);

    for(int i = 0;i <= uN;i++)
    {
      Plane temPlaneX = PYZ;
      temPlaneX.Translate(i * XMove);
      XCutPlanes.Add(temPlaneX);
    }
    for(int j = 0;j <= vN;j++)
    {
      Plane temPlaneY = PZX;
      temPlaneY.Translate(j * YMove);
      YCutPlanes.Add(temPlaneY);
    }
    A = XCutPlanes;
    B = YCutPlanes;
    //C = vertices[0];
# ---------- c_script: C# additional code ----------
  List<Point3d> CurvePlaneIntersections(Curve C, List<Plane> P)
  {
    List<Point3d> IPoints = new List<Point3d>();
    for(int j = 0;j < P.Count;j++)
    {
      Rhino.Geometry.Intersect.CurveIntersections CP = Rhino.Geometry.Intersect.Intersection.CurvePlane(C, P[j], 0.01);
      for(int i = 0;i < CP.Count;i++)
      {
        Rhino.Geometry.Intersect.IntersectionEvent IE = CP[i];
        if (IE.IsPoint){IPoints.Add(IE.PointA);}
      }
    }
    return IPoints;
  }
# ---------- end c_script ----------
crv_u1_2 = Curve(reparameterize(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))
crv_u2_2 = Curve(reparameterize(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))
crv_v1_2 = Curve(reparameterize(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))
crv_v2_2 = Curve(reparameterize(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))
v_n_2 = Number(Slider(23, range=0..100))
u_n_2 = Number(Slider(44, range=0..100))
pt = Point(c_script.C)
bbox = BoundingBox(Content=[crv_u1, crv_u2, crv_v1, crv_v2], Plane=PlaneXY(0, 0, 0), UnionBox=True)  # -> Box, Box_2
sph = Sphere(Base=pt, Radius=1)
boxprop = BoxProperties(Box=bbox.Box)  # -> Center, Diagonal, Area, Volume, Degeneracy
c__coon_spatch = CSharpScript(u1=crv_u1_2, u2=crv_u2_2, v1=crv_v1_2, v2=crv_v2_2, uN=u_n_2, vN=v_n_2)  # -> out, G; inputs u1: Curve, u2: Curve, v1: Curve, v2: Curve, uN: Int32, vN: Int32
# ---------- c__coon_spatch: C# ----------
    Point3d[] vertices = new Point3d[4];
    vertices[0] = u1.PointAtStart;
    vertices[1] = v1.PointAtStart;
    vertices[2] = u2.PointAtStart;
    vertices[3] = v2.PointAtStart;
    Point3dList VList = new Point3dList(vertices);
    VList.Sort();
    vertices = VList.ToArray();
    BoundingBox BB = new BoundingBox(vertices);
    BoundingBox BU1 = u1.GetBoundingBox(false);
    BoundingBox BU2 = u2.GetBoundingBox(false);
    BoundingBox BV1 = v1.GetBoundingBox(false);
    BoundingBox BV2 = v2.GetBoundingBox(false);
    BB.Union(BU1);
    BB.Union(BU2);
    BB.Union(BV1);
    BB.Union(BV2);
    //B = BB;
    Vector3d Diagonal = BB.Diagonal;
    double USize = Diagonal.X / (double) uN;
    double VSize = Diagonal.Y / (double) vN;
    Print(string.Format("{0},{1}", USize.ToString(), VSize.ToString()));

    List<Plane> XCutPlanes = new List<Plane>();
    List<Plane> YCutPlanes = new List<Plane>();
    Plane PZX = Plane.WorldZX;
    PZX.Origin = vertices[0];
    Plane PYZ = Plane.WorldYZ;
    PYZ.Origin = vertices[0];
    Vector3d XMove = new Vector3d(USize, 0, 0);
    Vector3d YMove = new Vector3d(0, VSize, 0);

    DataTree<Point3d> UPoints = new DataTree<Point3d>();
    DataTree<Point3d> VPoints = new DataTree<Point3d>();

    List<Point3d> u1Points = new List<Point3d>();
    List<Point3d> u2Points = new List<Point3d>();
    List<Point3d> v1Points = new List<Point3d>();
    List<Point3d> v2Points = new List<Point3d>();


    for(int i = 0;i <= uN;i++)
    {
      Plane temPlaneX = PYZ;
      temPlaneX.Translate(i * XMove);
      XCutPlanes.Add(temPlaneX);
    }

    for(int j = 0;j <= vN;j++)
    {
      Plane temPlaneY = PZX;
      temPlaneY.Translate(j * YMove);
      YCutPlanes.Add(temPlaneY);
    }

    u1Points = CurvePlaneIntersections(u1, YCutPlanes);
    u2Points = CurvePlaneIntersections(u2, YCutPlanes);
    v1Points = CurvePlaneIntersections(v1, XCutPlanes);
    v2Points = CurvePlaneIntersections(v2, XCutPlanes);

    List<Line> uLines = new List<Line>();
    List<Line> vLines = new List<Line>();
    for(int i = 0;i <= uN;i++)
    {
      uLines.Add(new Line(v1Points[i], v2Points[i]));
    }
    for(int j = 0;j <= vN;j++)
    {
      vLines.Add(new Line(u1Points[j], u2Points[j]));
    }

    for(int i = 0;i <= uN;i++)
    {
      UPoints.EnsurePath(i);
      UPoints.Branch(i).AddRange(CurvePlaneIntersections(uLines[i].ToNurbsCurve(), YCutPlanes));
    }
    for(int j = 0;j <= vN;j++)
    {
      VPoints.EnsurePath(j);
      VPoints.Branch(j).AddRange(CurvePlaneIntersections(vLines[j].ToNurbsCurve(), XCutPlanes));
    }

    //    Line u1L = new Line(u1.PointAtStart, u1.PointAtEnd);
    //    Line u2L = new Line(u2.PointAtStart, u2.PointAtEnd);
    Line v1L = new Line(v1.PointAtStart, v1.PointAtEnd);
    Line v2L = new Line(v2.PointAtStart, v2.PointAtEnd);
    List<Point3d> v1LPoints = CurvePlaneIntersections(v1L.ToNurbsCurve(), XCutPlanes);
    List<Point3d> v2LPoints = CurvePlaneIntersections(v2L.ToNurbsCurve(), XCutPlanes);
    DataTree<Point3d> UVPoints = new DataTree<Point3d>();
    List < Line > uvLines = new List<Line>();
    for(int i = 0;i <= uN;i++)
    {
      UVPoints.EnsurePath(i);
      Line uvLine = new Line(v1LPoints[i], v2LPoints[i]);
      uvLines.Add(uvLine);
      UVPoints.Branch(i).AddRange(CurvePlaneIntersections(uvLine.ToNurbsCurve(), YCutPlanes));
    }

    DataTree<Point3d> GridPoints = new DataTree<Point3d>();
    for(int i = 0;i <= uN;i++)
    {
      GridPoints.EnsurePath(i);
      for(int j = 0;j <= vN;j++)
      {
        Point3d GridPoint =  UPoints.Branch(i)[j] + VPoints.Branch(j)[i] - new Vector3d(UVPoints.Branch(i)[j]);// -UVPoints.Branch(i)[j];//Upoint+Vpoint-UVpoint
        GridPoints.Branch(i).Add(GridPoint);
      }
    }
    G = GridPoints;
# ---------- c__coon_spatch: C# additional code ----------
  List<Point3d> CurvePlaneIntersections(Curve C, List<Plane> P)
  {
    List<Point3d> IPoints = new List<Point3d>();
    for(int j = 0;j < P.Count;j++)
    {
      Rhino.Geometry.Intersect.CurveIntersections CP = Rhino.Geometry.Intersect.Intersection.CurvePlane(C, P[j], 0.01);
      for(int i = 0;i < CP.Count;i++)
      {
        Rhino.Geometry.Intersect.IntersectionEvent IE = CP[i];
        if (IE.IsPoint){IPoints.Add(IE.PointA);}
      }
    }
    return IPoints;
  }
# ---------- end c__coon_spatch ----------
panel = Panel(c__coon_spatch.out)
panel_2 = Panel(c_script.out)
pdecon = Deconstruct(Point=boxprop.Diagonal)  # -> XComponent, YComponent, ZComponent
division = Division(A=pdecon.XComponent, B=u_n)
division_2 = Division(A=pdecon.YComponent, B=v_n)
series = Series(Start=0, Step=division_2, Count=expr("x+1", v_n))
series_2 = Series(Start=0, Step=division, Count=expr("x+1", u_n))
end = EndPoints(Curve=crv_u1)  # -> Start, End
xz = XZPlane(Origin=end.Start)
yz = YZPlane(Origin=end.Start)
X = UnitX(Factor=expr("-x", series_2))
Y = UnitY(Factor=series)
c_script_2 = CSharpScript(P=flatten(c__coon_spatch.G), U=u_n_2, V=v_n_2)  # -> out, A; inputs P: list of Point3d, U: Int32, V: Int32, C: list of Color
# ---------- c_script_2: C# ----------
    Mesh M = new Mesh();
    M.Vertices.AddVertices(P);
    if(C != null){M.VertexColors.AppendColors(C.ToArray());}


    for(int i = 0;i < U ;i++)
      for(int j = 0;j < V;j++)
      {
        {
          int n0,n1,n2,n3;
          n0 = i * (V + 1) + j;
          Print(n0.ToString());
          n1 = n0 + 1;
          n2 = n1 + V+1;
          n3 = n2 - 1;
          MeshFace face = new MeshFace(n0, n1, n2, n3);
          //Print(string.Join(",", new string[]{face.A.ToString(), face.B.ToString(), face.C.ToString(), face.D.ToString()}));
          M.Faces.AddFace(face);
        }
      }
    A = M;
# ---------- end c_script_2 ----------
msmooth = SmoothMesh(Mesh=c_script_2.A, Strength=0.5, SkipNaked=True, Iterations=Slider(3, range=0..10))
points = PointList(Points=flatten(c__coon_spatch.G))
end_2 = EndPoints(Curve=crv_u1)  # -> Start, End
end_3 = EndPoints(Curve=crv_u2)  # -> Start, End
end_4 = EndPoints(Curve=crv_v1)  # -> Start, End
move = Move(Geometry=xz, Motion=Y)  # -> Geometry, Transform
pln = Plane(move.Geometry)
c_script_3 = CSharpScript(C=crv_u2, P=pln)  # -> out, A; inputs C: Curve, P: list of Plane
# ---------- c_script_3: C# ----------
    A = CurvePlaneIntersections(C, P);
# ---------- c_script_3: C# additional code ----------
  List<Point3d> CurvePlaneIntersections(Curve C, List<Plane> P)
  {
    List<Point3d> IPoints = new List<Point3d>();
    for(int j = 0;j < P.Count;j++)
    {
      Rhino.Geometry.Intersect.CurveIntersections CP = Rhino.Geometry.Intersect.Intersection.CurvePlane(C, P[j], 0.01);
      for(int i = 0;i < CP.Count;i++)
      {
        Rhino.Geometry.Intersect.IntersectionEvent IE = CP[i];
        if (IE.IsPoint){IPoints.Add(IE.PointA);}
      }
    }
    return IPoints;
  }
# ---------- end c_script_3 ----------
c_script_4 = CSharpScript(C=crv_u2, P=pln)  # -> out, A; inputs C: Curve, P: list of Plane
# ---------- c_script_4: C# ----------
    List<Point3d> IPoints = new List<Point3d>();
    for(int j = 0;j < P.Count;j++)
    {
      Rhino.Geometry.Intersect.CurveIntersections CP = Rhino.Geometry.Intersect.Intersection.CurvePlane(C, P[j], 0.01);
      for(int i = 0;i < CP.Count;i++)
      {
        Rhino.Geometry.Intersect.IntersectionEvent IE = CP[i];
        if (IE.IsPoint){IPoints.Add(IE.PointA);}
      }
    }
    A = IPoints;
# ---------- end c_script_4 ----------
c_script_5 = CSharpScript(C=crv_u1, P=pln)  # -> out, A; inputs C: Curve, P: list of Plane; same code as c_script_4
c_script_6 = CSharpScript(C=crv_u1, P=pln)  # -> out, A; inputs C: Curve, P: Plane
# ---------- c_script_6: C# ----------
    Rhino.Geometry.Intersect.CurveIntersections CP = Rhino.Geometry.Intersect.Intersection.CurvePlane(C, P, 0.01);
    List<Point3d> IPoints = new List<Point3d>();
    for(int i = 0;i < CP.Count;i++)
    {
      Rhino.Geometry.Intersect.IntersectionEvent IE = CP[i];
      if (IE.IsPoint){IPoints.Add(IE.PointA);}
    }
    A = IPoints;
# ---------- end c_script_6 ----------
pcx = CurvePlane(Curve=crv_u2, Plane=pln)  # -> Points, ParamsC, ParamsP
pcx_2 = CurvePlane(Curve=crv_u1, Plane=pln)  # -> Points, ParamsC, ParamsP
move_2 = Move(Geometry=yz, Motion=X)  # -> Geometry, Transform
pln_2 = Plane(move_2.Geometry)
pcx_3 = CurvePlane(Curve=crv_v2, Plane=pln_2)  # -> Points, ParamsC, ParamsP
pcx_4 = CurvePlane(Curve=crv_v1, Plane=pln_2)  # -> Points, ParamsC, ParamsP
end_5 = EndPoints(Curve=crv_v2)  # -> Start, End
medges = MeshEdges(Mesh=c_script_2.A)  # -> NakedEdges, InteriorEdges, NonManifoldEdges
dots = DotDisplay(Point=c__coon_spatch.G, Colour=ColourSwatch(SwatchColor=RGB(0, 242, 255)), Size=Slider(0.4, range=0..1))
ln = Line(StartPoint=end_2.Start, EndPoint=end_2.End)
ln_2 = Line(StartPoint=end_3.Start, EndPoint=end_3.End)
ln_3 = Line(StartPoint=end_4.Start, EndPoint=end_4.End)
ln_4 = Line(StartPoint=end_5.Start, EndPoint=end_5.End)
ln_5 = Line(StartPoint=pcx_4.Points, EndPoint=pcx_3.Points)
pcx_5 = CurvePlane(Curve=ln_5, Plane=pln)  # -> Points, ParamsC, ParamsP
ln_6 = Line(StartPoint=pcx_2.Points, EndPoint=pcx.Points)
pcx_6 = CurvePlane(Curve=ln_6, Plane=pln_2)  # -> Points, ParamsC, ParamsP
pln_3 = Plane(move.Geometry)
pln_4 = Plane(move_2.Geometry)
pcx_7 = CurvePlane(Curve=ln_3, Plane=pln_4)  # -> Points, ParamsC, ParamsP
pcx_8 = CurvePlane(Curve=ln_4, Plane=pln_4)  # -> Points, ParamsC, ParamsP
pcx_9 = CurvePlane(Curve=ln_2, Plane=pln_3)  # -> Points, ParamsC, ParamsP
pcx_10 = CurvePlane(Curve=ln, Plane=pln_3)  # -> Points, ParamsC, ParamsP
yz_2 = YZPlane(Origin=Point(-174.140712, 86.84508831, 0))
pt_2 = Point(<point referenced from the Rhino model>)
pshift = ShiftPaths(Data=pcx_6.Points, Offset=-1)  # -> simplify(Data)
pshift_2 = ShiftPaths(Data=pcx_5.Points, Offset=-1)  # -> simplify(Data)
ln_7 = Line(StartPoint=pcx_7.Points, EndPoint=pcx_8.Points)
flip = FlipMatrix(Data=pshift_2)
c_script_7 = CSharpScript(P=yz_2, W=Slider(4, range=0..10), L=Slider(6, range=0..10))  # -> out, A; inputs P: Plane, W: Double, L: Double
# ---------- c_script_7: C# ----------
    Rectangle3d R = new Rectangle3d(P, W, L);
    A = R;
# ---------- end c_script_7 ----------
python = PythonScript()  # -> Out, A
ln_8 = Line(StartPoint=pcx_10.Points, EndPoint=pcx_9.Points)
c_script_8 = CSharpScript(C=pt_2, u=Slider(5, range=0..10), v=Slider(8, range=0..10), w=Slider(6, range=0..10))  # -> out, A, B; inputs C: Point3d, u: Double, v: Double, w: Double
# ---------- c_script_8: C# ----------
    //make a new array as a container of points
    Point3d[] V = new Point3d[8];

    V[0] = C + new Vector3d(-u, -v, -w);
    V[1] = C + new Vector3d(+u, -v, -w);
    V[2] = C + new Vector3d(+u, +v, -w);
    V[3] = C + new Vector3d(-u, +v, -w);
    V[4] = C + new Vector3d(-u, -v, +w);
    V[5] = C + new Vector3d(+u, -v, +w);
    V[6] = C + new Vector3d(+u, +v, +w);
    V[7] = C + new Vector3d(-u, +v, +w);

    MeshFace[] F = new MeshFace[6];// the container of mesh faces
    F[0] = new MeshFace(0, 3, 2, 1);
    F[1] = new MeshFace(0, 4, 7, 3);
    F[2] = new MeshFace(0, 1, 5, 4);
    F[3] = new MeshFace(1, 2, 6, 5);
    F[4] = new MeshFace(2, 3, 7, 6);
    F[5] = new MeshFace(4, 5, 6, 7);
    A = V;
    Mesh M = new Mesh();
    M.Vertices.AddVertices(V);
    M.Faces.AddFaces(F);
    B = M;

    //    F[1] = new MeshFace(0, 3, 2, 1);
    //    F[2] = new MeshFace(0, 4, 7, 3);
    //    F[3] = new MeshFace(0, 3, 2, 1);
    //    F[4] = new MeshFace(0, 3, 2, 1);
    //    F[5] = new MeshFace(0, 3, 2, 1);
    //    F[6] = new MeshFace(0, 3, 2, 1);


    //A = V;
# ---------- c_script_8: C# additional code ----------
  /// <summary>
  /// This method will be called once every solution, before any calls to RunScript.
  /// </summary>
  public override void BeforeRunScript()
  { }
  /// <summary>
  /// This method will be called once every solution, after any calls to RunScript.
  /// </summary>
  public override void AfterRunScript()
  { }
# ---------- end c_script_8 ----------
srf = Surface(c_script_7.A)
addition = Addition(A=pshift, B=flip)  # -> simplify(Result)
panel_3 = Panel(c_script_7.out)
pln_5 = Plane(pln_2)
pln_6 = Plane(pln)
panel_4 = Panel(c_script_8.out)
points_2 = PointList(Points=c_script_8.A, Size=Slider(3, range=0..10))
pcx_11 = CurvePlane(Curve=ln_8, Plane=pln_5)  # -> simplify(Points), ParamsC, ParamsP
pshift_3 = ShiftPaths(Data=pcx_11.Points, Offset=-1)
pcx_12 = CurvePlane(Curve=ln_7, Plane=pln_6)  # -> simplify(Points), ParamsC, ParamsP
subtraction = Subtraction(A=addition, B=pshift_3)
flip_2 = FlipMatrix(Data=subtraction)
frompoints = MeshFromPoints(Points=flatten(flip_2), UDirection=expr("x+1", u_n), VDirection=expr("x+1", v_n))
medges_2 = MeshEdges(Mesh=frompoints)  # -> NakedEdges, InteriorEdges, NonManifoldEdges
dots_2 = DotDisplay(Point=subtraction, Colour=ColourSwatch(SwatchColor=RGB(0, 242, 255)), Size=Slider(0.4, range=0..1))
