# Grasshopper definition CodeExample_FirstWorkshop_PointNormals.gh (Grasshopper 0.9.76)
# Copyright: All rights reserved
# plug-ins: Python Interpreter

number_slider = Slider(0.4, range=0..1)
pt = Point([<point referenced from the Rhino model> x4356])
id = Guid(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)
pointnormals = RS_PointNormalsPy(points=pt, thresh=number_slider)  # -> out, normals; inputs points: list of Point3d
#   port out: Voxel centers as 3D points
# ---------- pointnormals: Python ----------
"""
This component produces point normals given a list of points, based on plane fitting method
"""

version = 'v0.0.1'
ghenv.Component.Message = version
ghenv.Component.Name = "RS_PointNormals.py"
ghenv.Component.NickName = 'PointNormals'
ghenv.Component.Category = "RS"
ghenv.Component.SubCategory = "0"

#------------input------------

import Grasshopper.Kernel as gh
import Rhino.Geometry as RG

ghenv.Component.Params.Input[0].NickName = "points"
ghenv.Component.Params.Input[0].Description = "A list of 3D points"

ghenv.Component.Params.Input[1].NickName = "thresh"
ghenv.Component.Params.Input[1].Description = "A threshold for plane fitting"

#------------output------------

ghenv.Component.Params.Output[1].NickName = "normals"
ghenv.Component.Params.Output[1].Description = "A list of normal vectors for each given point"

#------------code------------

def main(cloud, thresh):
    
    BB = RG.BoundingBox(cloud)

    VP = BB.Center
    VP.Z += 10 * BB.Diagonal.Z

    normals = []

    for point in cloud:
        neighbors = find_neighbors(point, cloud, thresh)
        plane = RG.Plane.FitPlaneToPoints(neighbors)[1]
        normal = plane.Normal
        if (VP - point) * normal < 0:
            normal = -normal
        
        normals.append(normal)
                  
    return normals
    
def find_neighbors(p, pts, thresh):
    neighs = []
    for pt in pts:
        if p.DistanceTo(pt) <= thresh:
            neighs.append(pt)
            
    return neighs

if points and thresh:
    normals = main(points, thresh)
# ---------- end pointnormals ----------
c_script = CSharpScript(id=id, r=number_slider)  # -> out, P, N, C; inputs id: Guid, r: Double
# ---------- c_script: C# ----------
    object obj = RhinoDocument.Objects.Find(id);
    if (obj == null)
      return;

    Rhino.DocObjects.PointCloudObject cloudObject = obj as Rhino.DocObjects.PointCloudObject;
    if (cloudObject == null)
      return;
    PointCloud cloud = cloudObject.PointCloudGeometry;
    BoundingBox BB = cloud.GetBoundingBox(false);

    Point3d VP = BB.Center;
    VP = VP + new Vector3d(0, 0, 10 * BB.Diagonal.Z);

    List<Point3d> points = new List<Point3d>();
    List<Vector3d> normals = null;
    List<Color> colours = null;

    //if (cloud.ContainsNormals)
    normals = new List<Vector3d>();
    //if (cloud.ContainsColors)
    colours = new List<Color>();

    foreach (PointCloudItem item in cloud)
    {
      points.Add(item.Location);
    }
    //
    //      if (normals != null)
    //        normals.Add(item.Normal);
    //      if (colours != null)
    //        colours.Add(item.Color);
    //    }

    P = points;


    for(int i = 0;i < points.Count;i++)
    {
      Point3d pivot = points[i];
      List<Point3d> neighbours = points.FindAll(lambda => lambda.DistanceTo(pivot) < 0.4);
      Plane PL = new Plane();
      Plane.FitPlaneToPoints(neighbours, out PL);
      Vector3d normal = PL.Normal;
      if ((VP - pivot) * normal > 0)
      {normals.Add(normal);}
      else
      {normals.Add(-normal);}
    }
    N = normals;
    C = colours;
# ---------- end c_script ----------
vb = VBScript(id=id)  # -> out, P, N, C; inputs id: Guid
# ---------- vb: VB ----------
    Dim obj As Object = RhinoDocument.Objects.Find(id)
    If obj Is Nothing Then
      Return
    End If

    Dim cloudObject As Rhino.DocObjects.PointCloudObject = TryCast(obj, Rhino.DocObjects.PointCloudObject)
    If cloudObject Is Nothing Then
      Return
    End If
    Dim cloud As PointCloud = cloudObject.PointCloudGeometry

    Dim points As New List(Of Point3d)()
    Dim normals As List(Of Vector3d) = Nothing
    Dim colours As List(Of Color) = Nothing

    If cloud.ContainsNormals Then
      normals = New List(Of Vector3d)()
    End If
    If cloud.ContainsColors Then
      colours = New List(Of Color)()
    End If

    For Each item As PointCloudItem In cloud
      points.Add(item.Location)

      If normals IsNot Nothing Then
        normals.Add(item.Normal)
      End If
      If colours IsNot Nothing Then
        colours.Add(item.Color)
      End If
    Next

    P = points
    N = normals
    C = colours
# ---------- end vb ----------
c_script_2 = CSharpScript(id=id)  # -> out, P, N, C; inputs id: Guid
# ---------- c_script_2: C# ----------
    object obj = RhinoDocument.Objects.Find(id);
    if (obj == null)
      return;

    Rhino.DocObjects.PointCloudObject cloudObject = obj as Rhino.DocObjects.PointCloudObject;
    if (cloudObject == null)
      return;
    PointCloud cloud = cloudObject.PointCloudGeometry;

    List<Point3d> points = new List<Point3d>();
    List<Vector3d> normals = null;
    List<Color> colours = null;

    if (cloud.ContainsNormals)
      normals = new List<Vector3d>();
    if (cloud.ContainsColors)
      colours = new List<Color>();

    foreach (PointCloudItem item in cloud)
    {
      points.Add(item.Location);

      if (normals != null)
        normals.Add(item.Normal);
      if (colours != null)
        colours.Add(item.Color);
    }

    P = points;
    N = normals;
    C = colours;

    for(int i = 0;i < points.Count;i++)
    {
      Point3d pivot = points[i];
      List<Point3d> neighbours = new List<Point3d>();
      for(int j = 0;j < points.Count;j++)
      {
        if (pivot.DistanceTo(points[j]) < 0.4)
        {neighbours.Add(points[j]);}
      }
    }
# ---------- end c_script_2 ----------
panel = Panel(c_script.out)
vdis = VectorDisplay(Anchor=pt, Vector=pointnormals.normals)
