# Grasshopper definition CodeExample_FirstWorkshop_Voxels_Corrected.gh (Grasshopper 0.9.76)
# Copyright: All rights reserved
# plug-ins: Python Interpreter

number_slider = Slider(1, range=0..10)
cone = Cone(Base=PlaneXY(0, 0, 0), Radius=6, Length=Slider(19, range=0..100))  # -> Cone, Tip
brep = Brep(cone.Cone)
cap = CapHoles(Brep=brep)
signeddist = RS_SignedDistancesPy(brep=cap, size=number_slider, norm=Toggle(True))  # -> out, geom, dist; inputs brep: Brep, norm: Boolean
# ---------- signeddist: Python ----------
"""
This component produces signed distances to a body 
"""

version = 'v0.0.1'
ghenv.Component.Message = version
ghenv.Component.Name = "RS_SignedDistances.py"
ghenv.Component.NickName = 'SignedDist'
ghenv.Component.Category = "RS"
ghenv.Component.SubCategory = "0"

#------------input------------

import Grasshopper.Kernel as gh
import Rhino.Geometry as RG
import math

ghenv.Component.Params.Input[0].NickName = "brep"
ghenv.Component.Params.Input[0].Description = "Any brep"

ghenv.Component.Params.Input[1].NickName = "size"
ghenv.Component.Params.Input[1].Description = "Voxel size"

ghenv.Component.Params.Input[2].NickName = "norm"
ghenv.Component.Params.Input[2].Description = "True - return normalised distances; False - return actual distances"

#------------output------------

ghenv.Component.Params.Output[1].NickName = "geom"
ghenv.Component.Params.Output[1].Description = "Voxel centers as 3D points"

ghenv.Component.Params.Output[2].NickName = "dist"
ghenv.Component.Params.Output[2].Description = "Signed distances to the voxel center"

#------------code------------

def main(BR, s):
    BB = BR.GetBoundingBox(False)
    diagon = BB.Diagonal
    
    U = int(math.ceil(diagon.X / s))
    V = int(math.ceil(diagon.Y / s))
    W = int(math.ceil(diagon.Z / s))
    
    voxelPoints = []
    distances = []
    
    offset = RG.Vector3d(s/2, s/2, s/2)
    
    for i in range(U):
        for j in range(V):
            for k in range(W):
                voxelPoint = BB.Min + RG.Vector3d(i*s, j*s, k*s) + offset
                voxelPoints.append(voxelPoint)
                CP = BR.ClosestPoint(voxelPoint)
                Distance = CP.DistanceTo(voxelPoint)
                inside = BR.IsPointInside(voxelPoint, s / 100, False)
                if inside:
                  distances.append(+Distance)
                else:
                  distances.append(-Distance)
                  
    return voxelPoints, distances
    
def normalise(values):
    MIN = min(values)
    MAX = max(values)
    span = MAX - MIN

    normalized = []

    for i in range(len(values)):
       normalized.append((values[i] - MIN) / span)

    return normalized

if brep and size:
    geom, dist = main(brep, size)
    if norm:
        dist = normalise(dist)
# ---------- end signeddist ----------
c_script = CSharpScript(BR=cap, s=number_slider)  # -> out, A, B; inputs BR: Brep, s: Double
# ---------- c_script: C# ----------
    BoundingBox BB = BR.GetBoundingBox(false);

    Point3d MinP = BB.Min;
    Point3d MaxP = BB.Max;

    Vector3d Diagonal = BB.Diagonal;
    Vector3d Offset = new Vector3d(s / 2, s / 2, s / 2);
    int U = (int) Math.Ceiling(Diagonal.X / s);
    int V = (int) Math.Ceiling(Diagonal.Y / s);
    int W = (int) Math.Ceiling(Diagonal.Z / s);
    List<Point3d> voxelPoints = new List<Point3d>();
    List<double> Distances = new List<double>();

    for (int i = 0;i < U;i++)
    {
      for (int j = 0;j < V;j++)
      {
        for (int k = 0;k < W;k++)
        {
          Point3d voxelPoint = MinP + new Point3d(i * s, j * s, k * s) + Offset;
          voxelPoints.Add(voxelPoint);
          double Distance = BR.ClosestPoint(voxelPoint).DistanceTo(voxelPoint);
          bool inside = BR.IsPointInside(voxelPoint, s / 10, false);
          if (inside) {Distances.Add(+Distance);}
          else {Distances.Add(-Distance);}
        }
      }
    }
    A = voxelPoints;
    B = Normalize(Distances.ToArray());
# ---------- c_script: C# additional code ----------
  public double[] Normalize(double[] Values)
  {
    double Min = Values.Min();
    double Max = Values.Max();
    double Span = Max - Min;

    double[] Normalized = new double[Values.Length];

    for (int i = 0; i < Values.Length; i++) {
      Normalized[i] = (Values[i] - Min) / Span;
    }
    return Normalized;
  }
# ---------- end c_script ----------
gradient = Gradient(
    LowerLimit=0,
    UpperLimit=1,
    Parameter=c_script.B,
    stops=[0: RGB(75, 107, 169), 0.245: RGB(173, 203, 249), 0.5: RGB(254, 244, 84), 0.751: RGB(234, 126, 0), 1: RGB(234, 38, 0)])
preview = CustomPreview(Geometry=c_script.A, Shader=gradient)
