# Grasshopper definition Construct_Deconstruct_Reconstruct_C#.gh (Grasshopper 0.9.76)
# Copyright: All rights reserved
# plug-ins: Python Interpreter

# ---- group: exemplary input data
building_heights = Panel("""12
15
24""")
building_footprints = Curve([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])

# ---- group: Construct
Z = UnitZ(Factor=building_heights)
extr = Extrude(Base=building_footprints, Direction=Z)
cap = CapHoles(Brep=extr)
mesh = Mesh(cap)

# ----
mesh_2 = Mesh(mesh)

# ---- group: deconstruct
deconstruct = CSharpScript(x=mesh_2)  # -> out, V, F; inputs x: Mesh
# ---------- deconstruct: C# ----------
    V = x.Vertices;
    //E = x.TopologyEdges;
    F = x.Faces;
# ---------- end deconstruct ----------
format_f = CSharpScript(x=deconstruct.F)  # -> out, A; inputs x: list
# ---------- format_f: C# ----------
    List<string> faceStrings = new List<string>();

    foreach (object faceObject in x)
    {
      MeshFace face = (MeshFace) faceObject;
      string faceString = null;
      if(face.IsTriangle)
      {
        faceString = string.Format("{0},{1},{2}", face.A.ToString(), face.B.ToString(), face.C.ToString());
      }
      if(face.IsQuad)
      {
        faceString = string.Format("{0},{1},{2},{3}", face.A.ToString(), face.B.ToString(), face.C.ToString(), face.D.ToString());
      }
      faceStrings.Add(faceString);
    }
    A = faceStrings;
# ---------- end format_f ----------

# ----
pdecon = Deconstruct(Point=deconstruct.V)  # -> XComponent, YComponent, ZComponent
deconstruct_2 = RS_DeconstructPy(mesh=mesh_2)  # -> out, vertices, faces; inputs mesh: Mesh
#   port out: Voxel centers as 3D points
# ---------- deconstruct_2: Python ----------
"""
This component deconstructs a mesh into its faces and vertices 
"""

version = 'v0.0.1'
ghenv.Component.Message = version
ghenv.Component.Name = "RS_Deconstruct.py"
ghenv.Component.NickName = 'Deconstruct'
ghenv.Component.Category = "RS"
ghenv.Component.SubCategory = "0"

#------------input------------

import Grasshopper.Kernel as gh

ghenv.Component.Params.Input[0].NickName = "mesh"
ghenv.Component.Params.Input[0].Description = "A mesh to deconstruct"

#------------output------------

ghenv.Component.Params.Output[1].NickName = "vertices"
ghenv.Component.Params.Output[1].Description = "Vertices of a deconstructed mesh"

ghenv.Component.Params.Output[2].NickName = "faces"
ghenv.Component.Params.Output[2].Description = "Faces of a deconstructed mesh"

#------------code------------

def main(m):
    ver = m.Vertices
    
    fac = []
    for face in m.Faces:
        fac.append(face2string(face))
        
    return ver, fac
    
def face2string(f):
    
    if f.IsTriangle:
        faceString = ','.join([str(f.A), str(f.B), str(f.C)])
    elif f.IsQuad:
        faceString = ','.join([str(f.A), str(f.B), str(f.C), str(f.D)])

    return faceString
  

if mesh:
    vertices, faces = main(mesh)
# ---------- end deconstruct_2 ----------
expression = Expression(x=pdecon.XComponent, y=pdecon.YComponent, z=pdecon.ZComponent, Expression="Format(\"{0}, {1}, {2}\", x*2, y*3, z)")

# ---- group: do something here
vertices = Panel(deconstruct.V)
fromatted_faces = Panel(format_f.A)

# ----
construct = RS_ConstructPy(vertices=deconstruct_2.vertices, faces=deconstruct_2.faces)  # -> out, mesh; inputs vertices: list of Point3d, faces: list
#   port out: Voxel centers as 3D points
# ---------- construct: Python ----------
"""
This component constructs a mesh from its faces and vertices 
"""

version = 'v0.0.1'
ghenv.Component.Message = version
ghenv.Component.Name = "RS_Construct.py"
ghenv.Component.NickName = 'Construct'
ghenv.Component.Category = "RS"
ghenv.Component.SubCategory = "0"

#------------input------------

import Grasshopper.Kernel as gh
import Rhino.Geometry as RG

ghenv.Component.Params.Input[0].NickName = "vertices"
ghenv.Component.Params.Input[0].Description = "List of vertices of a deconstructed mesh"

ghenv.Component.Params.Input[1].NickName = "faces"
ghenv.Component.Params.Input[1].Description = "List of faces of a deconstructed mesh"

#------------output------------

ghenv.Component.Params.Output[1].NickName = "mesh"
ghenv.Component.Params.Output[1].Description = "A mesh"

#------------code------------

def main(ver, fac):
    M = RG.Mesh()
    
    for v in ver:
        M.Vertices.Add(v)

    for f in fac:
        indices = f.split(',')
        if len(indices) == 3:
            face = RG.MeshFace(int(indices[0]), int(indices[1]), int(indices[2]))
        elif len(indices) == 4:
            face = RG.MeshFace(int(indices[0]), int(indices[1]), int(indices[2]), int(indices[3]))
        M.Faces.AddFace(face)
        
    return M
   
  

if vertices and faces:
    mesh = main(vertices, faces)
# ---------- end construct ----------

# ---- group: reconstruct
c_script = CSharpScript(V=expression, F=fromatted_faces)  # -> out, A; inputs V: list of Point3d, F: list of String
# ---------- c_script: C# ----------
    Mesh M = new Mesh();
    List<MeshFace> faces = new List<MeshFace>();

    for(int i = 0;i < F.Count;i++)
    {
      MeshFace face = new MeshFace();
      string[] indices = F[i].Split(',');
      if(indices.Length == 3)//triangles
      {
        face = new MeshFace(Int32.Parse(indices[0]), Int32.Parse(indices[1]), Int32.Parse(indices[2]));
      }
      if(indices.Length == 4)//quadrangles
      {
        face = new MeshFace(Int32.Parse(indices[0]), Int32.Parse(indices[1]), Int32.Parse(indices[2]), Int32.Parse(indices[3]));//parsing is necessary to convert strings to integers in C#
      }
      faces.Add(face);
      Print(face.A.ToString());
    }

    M.Vertices.AddVertices(V);
    M.Faces.AddFaces(faces);
    A = M;
# ---------- end c_script ----------

# ----
mesh_3 = Mesh(c_script.A)
