# Grasshopper definition Construct_Deconstruct_Reconstruct_Python.gh (Grasshopper 0.9.76)
# plug-ins: Python Interpreter, SlingshotDB

# ---- group: 1. Establish db. conn.
# Contributors:
# R.C. Braggaar
# IJsbrand Groeneveld
# Brenda Olsen
# Enable PostGIS extension
panel = Panel("localhost")
cstring = RS_CStringPy(server=panel, port="5432", username="postgres", database="geo1004", password="gericom")  # -> out, CString
# ---------- cstring: Python ----------
"""

This is a component that allows you to generate a database connection string to be later used in Slingshot plugin

"""



version = 'v0.0.1'

ghenv.Component.Message = version

ghenv.Component.Name = "RS_CString.py"

ghenv.Component.NickName = 'CString'

ghenv.Component.Category = "RS"

ghenv.Component.SubCategory = "0"



#------------input------------



import Grasshopper.Kernel as gh



ghenv.Component.Params.Input[0].NickName = "driver"

ghenv.Component.Params.Input[0].Description = "(optional) Driver used for database connection, default - PostgreSQL ODBC Driver(Unicode)"

if not driver:

    driver = 'PostgreSQL ODBC Driver(Unicode)'

    

ghenv.Component.Params.Input[1].NickName = "server"

ghenv.Component.Params.Input[1].Description = "(optional) Database server, default - localhost"

if not server:

    server = 'localhost'

    

ghenv.Component.Params.Input[2].NickName = "port"

ghenv.Component.Params.Input[2].Description = "(optional) Database connection port, default - 5432"

if not port:

    port = '5432'

    

ghenv.Component.Params.Input[3].NickName = "username"

ghenv.Component.Params.Input[3].Description = "(optional) Username or User ID, default - postgres"

if not username:

    username = 'postgres'

    

ghenv.Component.Params.Input[4].NickName = "database"

ghenv.Component.Params.Input[4].Description = "(optional) Database name, default - postgres"

if not database:

    database = 'postgres'

    

ghenv.Component.Params.Input[5].NickName = "password"

ghenv.Component.Params.Input[5].Description = "Needs to be provided by the user"

if not password:

    w = gh.GH_RuntimeMessageLevel.Warning

    ghenv.Component.AddRuntimeMessage(w, 'No password provided')

    

 #------------output------------

    

ghenv.Component.Params.Output[1].NickName = "CString"

ghenv.Component.Params.Output[1].Description = "Connection String"



#------------code------------



CString = 'Driver={{{0}}}; Server={1}; Port={2}; Uid={3}; Database={4}; Pwd={5}; commandtimeout=20; Timeout=5'.format(driver, server, port, username, database, password)
# ---------- end cstring ----------
cstring_2 = Text(cstring.CString)

# ---- group: 4. Implement data model
drop_tables = Panel("""DROP TABLE IF EXISTS faces;
DROP TABLE IF EXISTS vertices;""")
create_tables = Panel("""CREATE TABLE IF NOT EXISTS vertices(
ob_id int NOT NULL,
v_id int NOT NULL,
geom geometry NOT NULL);

CREATE TABLE IF NOT EXISTS faces(
ob_id int NOT NULL,
f_id int NOT NULL,
v_a int NOT NULL,
v_b int NOT NULL,
v_c int NOT NULL,
v_d int,
geom geometry NOT NULL);""")
execute_query = BooleanToggle(False)
execute_query_2 = BooleanToggle(False)
odbccommand = ODBCCommand(ConnectionString=cstring_2, ConnectToggle=execute_query, Command=create_tables)
odbccommand_2 = ODBCCommand(ConnectionString=cstring_2, ConnectToggle=execute_query_2, Command=drop_tables)
panel_2 = Panel(odbccommand)
panel_3 = Panel(odbccommand_2)

# ---- group: 2. Construct mesh objects
building_heights = Panel("""12
15
24""")
building_footprints = Curve([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])
Z = UnitZ(Factor=building_heights)
extr = Extrude(Base=building_footprints, Direction=Z)
cap = CapHoles(Brep=extr)
mesh = Mesh(cap)

# ---- group: 3. Deconstruct into faces and vertices
python = PythonScript(mesh=mesh)  # -> out; inputs mesh: list of Mesh
# ---------- python: Python ----------
import Rhino.Geometry as rg

i = 0
j = 0
k = 0
pt = {}

for object in mesh:
    i += 1
    for vertex in object.Vertices:
        pt[j] = [vertex.X.real,vertex.Y.real,vertex.Z.real]
#        print pt[j][0], pt[j][1], pt[j][2]
        geom = "ST_GeomFromText('Point(" + vertex.X.ToString() + " " + vertex.Y.ToString() + " " + vertex.Z.ToString() + ")',0))"
        print 'INSERT INTO vertices VALUES (',i,',',j,',',geom,';'
        j += 1
    for face in object.Faces:
        if face.IsTriangle:
            facestring = [face.A.real,face.B.real,face.C.real]
#            print facestring
#                print pt.get(facestring[0]), pt.get(facestring[1]), pt.get(facestring[2])
            geom_face = "ST_GeomFromText('POLYGON((" + str(pt.get(facestring[0])).replace(',','') + ", " + str(pt.get(facestring[1])).replace(',','') + ", " + str(pt.get(facestring[2])).replace(',','') + ", " + str(pt.get(facestring[0])).replace(',','') + "))',0));"
            geom_face = geom_face.replace('[','').replace(']','')
#           print geom_face
            print 'INSERT INTO faces (ob_id,f_id,v_a,v_b,v_c,geom) VALUES(',i,',',k,',',facestring[0],',',facestring[1],',',facestring[2],',',geom_face
            k += 1
        if face.IsQuad:
            facestring = [face.A.real,face.B.real,face.C.real,face.D.real]
#            print facestring
#            if  facestring[0] and facestring[1] and facestring[2] and facestring[3] in pt.keys():
            geom_face = "ST_GeomFromText('POLYGON((" + str(pt.get(facestring[0])).replace(',','') + ", " + str(pt.get(facestring[1])).replace(',','') + ", " + str(pt.get(facestring[2])).replace(',','') + ", " + str(pt.get(facestring[3])).replace(',','') + ", " +  str(pt.get(facestring[0])).replace(',','') + "))',0));"
            geom_face = geom_face.replace('[','').replace(']','')
            print 'INSERT INTO faces (ob_id,f_id,v_a,v_b,v_c,v_d,geom) VALUES(',i,',',k,',',facestring[0],',',facestring[1],',',facestring[2],',',facestring[3],',',geom_face
            k += 1
# ---------- end python ----------
command_to_insert_data = Panel(python)

# ---- group: 5. Insert data
start_insert = BooleanToggle(False)
odbccommand_3 = ODBCCommand(ConnectionString=cstring_2, ConnectToggle=start_insert, Command=command_to_insert_data)
panel_4 = Panel(odbccommand_3)

# ---- group: 6. Retrieve and re-construct
create_object_separations = Panel("SELECT COUNT(*) FROM faces GROUP BY ob_id;")
create_object_separations_2 = Panel("SELECT COUNT(*) FROM vertices GROUP BY ob_id;")
select_faces = Panel("SELECT (ob_id,v_a,v_b,v_c,v_d) FROM faces;")
select_vertices = Panel("SELECT ST_AsText(geom) FROM vertices;")
retrieve_faces = BooleanToggle(True)
retrieve_vertices = BooleanToggle(True)
odbc_query = ODBCQuery(ConnectString=cstring_2, ConnectToggle=retrieve_vertices, Query=select_vertices, ColumnNumber=0)  # -> Exceptions, ColumnQueryResult, QueryResult
odbc_query_2 = ODBCQuery(ConnectString=cstring_2, ConnectToggle=retrieve_faces, Query=select_faces, ColumnNumber=0)  # -> Exceptions, ColumnQueryResult, QueryResult
odbc_query_3 = ODBCQuery(ConnectString=cstring_2, ConnectToggle=retrieve_vertices, Query=create_object_separations, ColumnNumber=0)  # -> Exceptions, ColumnQueryResult, QueryResult
odbc_query_4 = ODBCQuery(ConnectString=cstring_2, ConnectToggle=retrieve_vertices, Query=create_object_separations_2, ColumnNumber=0)  # -> Exceptions, ColumnQueryResult, QueryResult
panel_5 = Panel(odbc_query_2.ColumnQueryResult)
format_vertices = PythonScript(input=odbc_query.QueryResult)  # -> out, b; inputs input: list
# ---------- format_vertices: Python ----------
import Rhino.Geometry as rg

pt_list = []

for item in input:    
    temp = item.split("(",1)[1][:-1]
    x = temp.split(" ")[0]
    y = temp.split(" ")[1]
    z = temp.split(" ")[2]
    pt_list.append(rg.Point3d(float(x), float(y), float(z)))
b = pt_list
# ---------- end format_vertices ----------
panel_6 = Panel(odbc_query_3.QueryResult)
panel_7 = Panel(odbc_query_4.QueryResult)
panel_8 = Panel(format_vertices.b)
format_faces = PythonScript(input=panel_5)  # -> out, faces; inputs input: list
# ---------- format_faces: Python ----------
import Rhino.Geometry as rg

face_list = []
for line in input:
    face = line[:-1]
    face = face.strip(",")
    face = face.split(",", 1)[1]
    face_list.append(face)
faces = face_list
# ---------- end format_faces ----------
vertex_2d_list = PythonScript(v=format_vertices.b, Sep=panel_7)  # -> out, list2D; inputs v: list of Point3d, Sep: list
# ---------- vertex_2d_list: Python ----------
import Rhino.Geometry as rg

list2D = [] # list of lists 
p = 0

for i in range(len(Sep)):
    sublist = []
    for j in range(p,int(Sep[i])+p,1):
        sublist.append(v[j])
    p = j+1
    list2D.append(sublist)
    
print list2D[2][0]
# ---------- end vertex_2d_list ----------
face_2d_list = PythonScript(L=format_faces.faces, Sep=panel_6)  # -> out, list2D; inputs L: list, Sep: list
# ---------- face_2d_list: Python ----------
import Rhino.Geometry as rg

list2D = [] # list of lists 
p = 0

for i in range(len(Sep)):
    sublist = []
    for j in range(p,int(Sep[i])+p,1):
        sublist.append(L[j])
    p = j+1
    list2D.append(sublist)
    
print list2D
# ---------- end face_2d_list ----------
python_2 = PythonScript(faces=face_2d_list.list2D, vertices=vertex_2d_list.list2D)  # -> out, mesh; inputs faces: list, vertices: list
# ---------- python_2: Python ----------
import Rhino.Geometry as rg

m = []

for v in range(len(vertices)):
    t = rg.Mesh()
    m.append(t)
    for i in range(len(vertices[v])):
        m[v].Vertices.Add(vertices[v][i])

for f in range(len(faces)):
    for j in range(len(faces[f])):
        indices = faces[f][j].split(',')
        if len(indices) == 3:
            face = rg.MeshFace(int(indices[0]),int(indices[1]),int(indices[2]))
        elif len(indices) == 4:
            face = rg.MeshFace(int(indices[0]),int(indices[1]),int(indices[2]),int(indices[3]))
        m[f].Faces.AddFace(face)

mesh = m
# ---------- end python_2 ----------
mesh_2 = Mesh(python_2.mesh)
