# Grasshopper definition MeshSgementation.gh (Grasshopper 0.9.76)
# Copyright: All rights reserved

mesh = Mesh(<mesh referenced from the Rhino model>)
preview = CustomPreview(
    Geometry=mesh,
    Shader={ambient=RGB(128, 128, 128), diffuse=RGB(163, 126, 101), emission=RGB(0, 0, 0), shine=0, specular=RGB(255, 255, 255), transparency=0.5})
meshsegments = VBScript(M=mesh, t=Slider(30, range=0..100))  # -> out, A; inputs M: Mesh
# ---------- meshsegments: VB ----------
    if M is nothing or t <= 0 then exit sub
    M.FaceNormals.ComputeFaceNormals()
    Dim The_Faces As New list(Of MeshFace)
    The_Faces.AddRange(M.Faces)
    Dim Clusters As New list(Of List(Of Integer))
    For i As Integer=0 To M.Faces.Count - 1
      Dim index As int32 = i
      If clusters.count = 0 Or Clusters.FindAll(Function(x) x.contains(index)).count = 0 Then
        Dim cluster As New list(Of Integer)
        cluster.Add(i)
        For j As Integer=0 To M.Faces.AdjacentFaces(i).Count - 1
          Dim address As int32 = M.Faces.AdjacentFaces(i)(j)
          If isSimilar(M.FaceNormals(i), M.FaceNormals(address), t) Then cluster.Add(address)
        Next
        Cluster = GrowRegion(M, Cluster, t)
        Clusters.Add(Cluster)
      End If
    Next
    A = LOLtoTree(Clusters)
# ---------- meshsegments: VB additional code ----------
  Function GrowRegion(M As mesh, FaceRegion As List(Of int32), tol As Double) As List(Of int32)
    Dim indices As New list(Of int32)
    indices.AddRange(FaceRegion)
    For Each index As int32 In FaceRegion
      For k As Integer=0 To M.Faces.AdjacentFaces(index).Count - 1
        Dim address As int32 = M.Faces.AdjacentFaces(index)(k)
        If Not Indices.contains(address) And Not FaceRegion.contains(address) And IsSimilar(M.FaceNormals(index), M.FaceNormals(address), tol) Then
          indices.Add(Address)
          Indices = GrowRegion(M, indices, tol)
        End If
      Next
    Next
    return Indices
  End Function
  Function IsSimilar(a As Vector3f, b As Vector3f, tol As Double) As Boolean
    If Math.Acos(Math.Abs(a.x * b.x + a.Y * b.y + a.Z * b.Z)) < (Math.PI * tol) / 180 Then
      Return True
    Else
      Return False
    End If
  End Function
  Function LOLtoTree(LoL As List(Of List(Of Integer))) As datatree(Of Integer)
    Dim Tree As New datatree(Of Integer)
    For i As Integer=0 To LoL.count - 1
      Tree.EnsurePath(i)
      Tree.Branch(i).AddRange(LoL(i))
    Next
    return Tree
  End Function
# ---------- end meshsegments ----------
demesh = DeconstructMesh(Mesh=mesh)  # -> Vertices, Faces, Colours, Normals
item = ListItem(List=demesh.Faces, Index=meshsegments.A, Wrap=True)
medges = MeshEdges(Mesh=mesh)  # -> NakedEdges, InteriorEdges, NonManifoldEdges
conmesh = ConstructMesh(Vertices=demesh.Vertices, Faces=item)  # -> flatten(Mesh)
item_2 = ListItem(List=conmesh, Index=Slider(12, range=0..13), Wrap=True)
preview_2 = CustomPreview(Geometry=item_2, Shader=ColourSwatch(SwatchColor=RGB(0, 235, 180)))
