# Grasshopper definition ProgrammingExample_voxels.gh (Grasshopper 0.9.76)
# Copyright: All rights reserved

number_slider = Slider(1.1, range=0..10)
brep = Brep(<brep referenced from the Rhino model>)
brep_2 = Brep(brep)
brep_3 = Brep(brep)
vb = VBScript(SB=brep, s=Slider(1.9, range=0..10))  # -> out, A, B, C; inputs SB: Brep
# ---------- vb: VB ----------
    Dim VoxelPoints As New List(Of Point3d)

    Dim BBox As BoundingBox = SB.GetBoundingBox(False)
    B = BBox

    Dim MinP As Point3d = BBox.Min
    Dim MaxP As Point3d = BBox.Max
    C = MinP
    Dim SizeVec As Vector3d = BBox.Diagonal

    Dim kMax, jMax, iMax As Integer

    kMax = Math.Floor(SizeVec.Z / s)
    jMax = Math.Floor(SizeVec.Y / s)
    iMax = Math.Floor(SizeVec.x / s)
    Dim Offset As Vector3d = New Vector3d(s / 2, s / 2, s / 2)


    Dim i,j,k As Integer

    For k = 0 To kMax - 1
      For j = 0 To jMax - 1
        For i = 0 To iMax - 1
          Dim VoxelPoint As Point3d = MinP + New Point3d(i * s, j * s, k * s) + Offset

          VoxelPoints.Add(VoxelPoint)
        Next
      Next
    Next

    A = VoxelPoints
# ---------- end vb ----------
vb_2 = VBScript(SB=brep_2, s=Slider(1.9, range=0..10))  # -> out, A, B, C; inputs SB: Brep
# ---------- vb_2: VB ----------
    Dim VoxelPoints As New List(Of Point3d)

    Dim BBox As BoundingBox = SB.GetBoundingBox(False)
    B = BBox

    Dim MinP As Point3d = BBox.Min
    Dim MaxP As Point3d = BBox.Max
    C = MinP
    Dim SizeVec As Vector3d = BBox.Diagonal

    Dim kMax, jMax, iMax As Integer

    kMax = Math.Floor(SizeVec.Z / s)
    jMax = Math.Floor(SizeVec.Y / s)
    iMax = Math.Floor(SizeVec.x / s)
    Dim Offset As Vector3d = New Vector3d(s / 2, s / 2, s / 2)


    Dim i,j,k As Integer

    For k = 0 To kMax - 1
      For j = 0 To jMax - 1
        For i = 0 To iMax - 1
          Dim VoxelPoint As Point3d = MinP + New Point3d(i * s, j * s, k * s) + Offset
          If SB.IsPointInside(VoxelPoint, Rhino.RhinoDoc.ActiveDoc.ModelAbsoluteTolerance, False) Then
            VoxelPoints.Add(VoxelPoint)
          End If
            Next
      Next
            Next

            A = VoxelPoints
# ---------- end vb_2 ----------
vb_3 = VBScript(SB=brep_3, s=number_slider)  # -> out, A, B, C; inputs SB: Brep
# ---------- vb_3: VB ----------
    Dim VoxelPoints As New List(Of Point3d)
    Dim SignedDistance As New List(Of Double)

    Dim BBox As BoundingBox = SB.GetBoundingBox(False)
    B = BBox

    Dim MinP As Point3d = BBox.Min
    Dim MaxP As Point3d = BBox.Max
    C = MinP
    Dim SizeVec As Vector3d = BBox.Diagonal

    Dim kMax, jMax, iMax As Integer

    kMax = Math.Floor(SizeVec.Z / s)
    jMax = Math.Floor(SizeVec.Y / s)
    iMax = Math.Floor(SizeVec.x / s)
    Dim Offset As Vector3d = New Vector3d(s / 2, s / 2, s / 2)


    Dim i,j,k As Integer

    For k = 0 To kMax - 1
      For j = 0 To jMax - 1
        For i = 0 To iMax - 1
          Dim VoxelPoint As Point3d = MinP + New Point3d(i * s, j * s, k * s) + Offset
          If SB.IsPointInside(VoxelPoint, s / 10, False) Then
            VoxelPoints.Add(VoxelPoint)
          End If
        Next
      Next
    Next

    A = VoxelPoints
# ---------- end vb_3 ----------
vb_4 = VBScript(SB=brep_3, s=number_slider)  # -> out, A, B, C; inputs SB: Brep
# ---------- vb_4: VB ----------
    Dim SD As list(Of Double) = nothing
    A = VoxelizeClosedBrep(SB, s, SD)
    B = SD
    C = Normalize(SD.toArray)
# ---------- vb_4: VB additional code ----------
  Function VoxelizeClosedBrep(ByVal SB As Brep, ByVal s As Double, ByRef Distances As list(Of Double))
    Dim VoxelPoints As New List(Of Point3d)
    Dim SignedDistances As New List(Of Double)

    Dim BBox As BoundingBox = SB.GetBoundingBox(False)
    Dim MinP As Point3d = BBox.Min
    Dim MaxP As Point3d = BBox.Max
    'C = MinP
    Dim SizeVec As Vector3d = BBox.Diagonal

    Dim kMax, jMax, iMax As Integer

    kMax = Math.Floor(SizeVec.Z / s)
    jMax = Math.Floor(SizeVec.Y / s)
    iMax = Math.Floor(SizeVec.x / s)
    Dim Offset As Vector3d = New Vector3d(s / 2, s / 2, s / 2)

    Dim i,j,k As Integer
    For k = 0 To kMax - 1
      For j = 0 To jMax - 1
        For i = 0 To iMax - 1
          Dim VoxelPoint As Point3d = MinP + New Point3d(i * s, j * s, k * s) + Offset
          VoxelPoints.Add(VoxelPoint)
          Dim SignedDistance As Double = VoxelPoint.DistanceTo(SB.ClosestPoint(VoxelPoint))
          If SB.IsPointInside(VoxelPoint, s / 10, False) Then
            SignedDistances.Add(+SignedDistance)
          Else
            SignedDistances.Add(-SignedDistance)
          End If
        Next
      Next
    Next
    Distances = SignedDistances
    Return VoxelPoints
  End Function
  Function Normalize(Values() As Double)
    Dim Min As Double = Values.Min()
    Dim Max As Double = Values.Max
    Dim Span As Double = Max - Min

    Dim Normalized(Values.Length-1) As Double

    For i As Integer=0 To Values.Length - 1
      Normalized(i) = (Values(i) - Min) / Span
    Next
    Return Normalized
  End Function
# ---------- end vb_4 ----------
bnd = Bounds(Numbers=vb_4.B)
vb_5 = VBScript(SB=brep_3, s=number_slider)  # -> out, A, B, C; inputs SB: Brep
# ---------- vb_5: VB ----------
    Dim VoxelPoints As New List(Of Point3d)
    Dim SignedDistances As New List(Of Double)

    Dim BBox As BoundingBox = SB.GetBoundingBox(False)
    B = BBox

    Dim MinP As Point3d = BBox.Min
    Dim MaxP As Point3d = BBox.Max
    C = MinP
    Dim SizeVec As Vector3d = BBox.Diagonal

    Dim kMax, jMax, iMax As Integer

    kMax = Math.Floor(SizeVec.Z / s)
    jMax = Math.Floor(SizeVec.Y / s)
    iMax = Math.Floor(SizeVec.x / s)
    Dim Offset As Vector3d = New Vector3d(s / 2, s / 2, s / 2)


    Dim i,j,k As Integer

    For k = 0 To kMax - 1
      For j = 0 To jMax - 1
        For i = 0 To iMax - 1
          Dim VoxelPoint As Point3d = MinP + New Point3d(i * s, j * s, k * s) + Offset
          VoxelPoints.Add(VoxelPoint)
          Dim SignedDistance As Double = VoxelPoint.DistanceTo(SB.ClosestPoint(VoxelPoint))
          If SB.IsPointInside(VoxelPoint, s / 10, False) Then
            SignedDistances.Add(+SignedDistance)
          Else
            SignedDistances.Add(-SignedDistance)
          End If
        Next
      Next
    Next

    A = VoxelPoints
    B=SignedDistances
# ---------- end vb_5 ----------
dedomain = DeconstructDomain(Domain=bnd)  # -> Start, End
sph = Sphere(Base=vb.C, Radius=1)
sph_2 = Sphere(Base=vb_2.C, Radius=1)
panel = Panel(vb.out)
panel_2 = Panel(vb_2.out)
sph_3 = Sphere(Base=vb_3.C, Radius=1)
gradient = Gradient(
    LowerLimit=dedomain.Start,
    UpperLimit=dedomain.End,
    Parameter=vb_4.B,
    stops=[0: RGB(75, 107, 169), 0.245: RGB(173, 203, 249), 0.5: RGB(254, 244, 84), 0.751: RGB(234, 126, 0), 1: RGB(234, 38, 0)])
gradient_2 = Gradient(
    LowerLimit=0,
    UpperLimit=1,
    Parameter=vb_4.C,
    stops=[0: RGB(75, 107, 169), 0.245: RGB(173, 203, 249), 0.5: RGB(254, 244, 84), 0.751: RGB(234, 126, 0), 1: RGB(234, 38, 0)])
panel_3 = Panel(vb_4.A)
preview = CustomPreview(Geometry=vb_4.A, Shader=gradient_2)
