# Grasshopper definition Python_VB_C#_1(1).gh (Grasshopper 0.9.76)
# Copyright: All rights reserved
# plug-ins: Python Interpreter

number_slider = Slider(0.383, range=0..1)
number_slider_2 = Slider(6, range=0..10)
vb = VBScript()  # -> Out, A
c_script = CSharpScript()  # -> Out, A
python = PythonScript()  # -> Out, A
pt = Point(<point referenced from the Rhino model>)
pt_2 = Point(<point referenced from the Rhino model>)
brep = Brep(<brep referenced from the Rhino model>)
srf = Surface(<surface referenced from the Rhino model>)
pt_3 = Point(<point referenced from the Rhino model>)
python_2 = PythonScript(pt=pt_3, srf=srf)  # -> out, a; inputs pt: Point3d, srf: Surface
# ---------- python_2: Python ----------
import Rhino
found,u,v=srf.ClosestPoint(pt)
if found:
    closest_pt=srf.PointAt(u,v)
    dir=pt-closest_pt
    normal=srf.NormalAt(u,v)
    a=normal*dir
# ---------- end python_2 ----------
python_3 = PythonScript(pt=pt_3, srf=srf)  # -> out, a; inputs pt: Point3d, srf: Surface
# ---------- python_3: Python ----------
import rhinoscriptsyntax as rs
u,v=rs.SurfaceClosestPoint(srf,pt)
closest_pt=rs.EvaluateSurface(srf,u,v)
dir=pt-closest_pt
normal=rs.SurfaceNormal(srf,[u,v])
a=normal*dir
# ---------- end python_3 ----------
c_script_2 = CSharpScript(x=brep, D=number_slider_2)  # -> out, A; inputs x: Brep, D: Double
# ---------- c_script_2: C# ----------
    Rhino.Geometry.AreaMassProperties Area = Rhino.Geometry.AreaMassProperties.Compute(x);
    Point3d box_center = Area.Centroid;
    Rhino.Geometry.Collections.BrepFaceList faces = x.Faces;
    Point3d center;
    Vector3d dir;
    List<Rhino.Geometry.Brep> exploded_faces = new List<Rhino.Geometry.Brep>();
    for (int i = 0; i < faces.Count; i++)
    {
      Rhino.Geometry.Brep extracted_face = x.Faces.ExtractFace(i);
      Area = Rhino.Geometry.AreaMassProperties.Compute(extracted_face);
      center = Area.Centroid;
      dir = center - box_center;
      dir.Unitize();
      dir = dir * D;
      extracted_face.Translate(dir);
      exploded_faces.Add(extracted_face);
    }
    A = exploded_faces;
# ---------- end c_script_2 ----------
c_script_3 = CSharpScript(A=pt, B=pt_2, t=number_slider)  # -> out, S1, S2; inputs A: Point3d, B: Point3d, t: Double
# ---------- c_script_3: C# ----------
    Rhino.Geometry.Point3d D,C1,C2;
    double r1,r2;
    D = A + t * (B - A);
    C1 = A + 0.5 * (D - A);
    C2 = D + 0.5 * (B - D);
    r1 = A.DistanceTo(C1);
    r2 = B.DistanceTo(C2);
    S1 = new Sphere(C1, r1);
    S2 = new Sphere(C2, r2);
# ---------- end c_script_3 ----------
python_4 = PythonScript(A=pt, B=pt_2, t=number_slider)  # -> out, S1, S2; inputs A: Point3d, B: Point3d
# ---------- python_4: Python ----------
import Rhino
D=A+t*(B-A)
C1=A+0.5*(D-A)
C2=B+0.5*(D-B)
r1=A.DistanceTo(C1)
r2=B.DistanceTo(C2)
S1=Rhino.Geometry.Sphere(C1,r1)
S2=Rhino.Geometry.Sphere(C2,r2)
# ---------- end python_4 ----------
# code snippets based on the book Essential Mathematics for Computational Design by Raja Issa, McNeel
vb_2 = VBScript(x=pt_3, y=srf)  # -> out, A; inputs x: Point3d, y: Surface
# ---------- vb_2: VB ----------
    Dim u,v As Double
    If y.ClosestPoint(x, u, v) Then
      Dim dir As Vector3d = x - y.PointAt(u, v)
      A = dir * y.NormalAt(u, v)
    End If
# ---------- end vb_2 ----------
python_5 = PythonScript(x=brep, D=number_slider_2)  # -> out, a; inputs x: Brep
# ---------- python_5: Python ----------
import Rhino
import rhinoscriptsyntax as rs
area=Rhino.Geometry.AreaMassProperties.Compute(x)
box_center=area.Centroid
faces=x.Faces
explode_faces=[]
for i, face in enumerate(faces):
    extracted_face=x.Faces.ExtractFace(i)
    area=Rhino.Geometry.AreaMassProperties.Compute(extracted_face)
    center=area.Centroid
    dir=center-box_center
    dir.Unitize()
    dir=dir*D
    extracted_face.Translate(dir)
    explode_faces.append(extracted_face)
a=explode_faces
# ---------- end python_5 ----------

# ---- group: just the distance
python_6 = PythonScript(x=pt_3, y=srf)  # -> out, a; inputs x: Point3d, y: Surface
# ---------- python_6: Python ----------
import Rhino
found,u,v=y.ClosestPoint(x)
if found:
    a=x.DistanceTo(y.PointAt(u,v))
# ---------- end python_6 ----------

# ----
srf_2 = Surface(<surface referenced from the Rhino model>)
crv = Curve(<curve referenced from the Rhino model>)
crv_2 = Curve(<curve referenced from the Rhino model>)
end = EndPoints(Curve=crv_2)  # -> Start, End
python_7 = PythonScript(f=Slider(2.549, range=0..10))  # -> out, a
# ---------- python_7: Python ----------
import rhinoscriptsyntax as rs
import math
dblA=10
dblB=-10
dblStep=-0.2
points=[]
for x in rs.frange(dblA,dblB,dblStep):
    y=f*math.sin(x)
    points.append(rs.AddPoint([x,y,0]))
a=rs.AddInterpCurve(points,3,0,None,None)
# ---------- end python_7 ----------
python_8 = PythonScript(x=srf_2)  # -> out, a; inputs x: Brep
# ---------- python_8: Python ----------
singularpoints=[]
for trim in x.Trims:
    if trim.Edge == None:
        p2d=trim.PointAtStart
        p3d=trim.Face.PointAt(p2d.X,p2d.Y)
        singularpoints.append(p3d)
a=singularpoints
# ---------- end python_8 ----------
python_9 = PythonScript(x=crv, y=crv_2)  # -> out, a; inputs x: Curve, y: Curve
# ---------- python_9: Python ----------
import Rhino
continuity=""
end_1=x.PointAtEnd
start_2=y.PointAtStart
if end_1.DistanceTo(start_2)==0:
    continuity="G0"
if continuity=="G0":
    T1=x.TangentAtEnd
    T2=y.TangentAtStart
    T1.Unitize()
    T2.Unitize()
    dot=T1*T2
    if dot==1:
        continuity="G1"
if continuity=="G1":
    t1=x.Domain.Max
    t2=y.Domain.Min
    C1=x.CurvatureAt(t1)
    C2=y.CurvatureAt(t2)
    C1.Unitize()
    C2.Unitize()
    dot=C1*C2
    if dot==1:
        continuity="G2"
a=continuity
# ---------- end python_9 ----------
pt_4 = Point(end.Start)
panel = Panel(python_7.out)
panel_2 = Panel(python_9.a)
