# Grasshopper definition Python_in_GH.gh (Grasshopper 0.9.76)
# plug-ins: Python Interpreter

yz = YZPlane(Origin=Point(0, 0, 0))
rectangle_py = Author_RectanglePy(width=Slider(3, range=0..10), length=Slider(4, range=0..10), plane=yz)  # -> out, area, geom, HAND
# ---------- rectangle_py: Python ----------
"""
This component produces a rectangle
"""

version = 'v.0.0.1'                             #indicate version number
ghenv.Component.Message = version
ghenv.Component.Name = "Author_Rectangle.py"    #indicate authore
ghenv.Component.NickName = "Rectangle.py"       #give a short name for the function

#-----------import---------------
import Grasshopper.Kernel as gh
import Rhino.Geometry as RG
import scriptcontext as sc

#------------imput---------------
ghenv.Component.Params.Input[0].NickName = "width"
ghenv.Component.Params.Input[0].Description = "Rectangle width"

ghenv.Component.Params.Input[1].NickName = "length"
ghenv.Component.Params.Input[1].Description = "Rectangle length"

ghenv.Component.Params.Input[2].NickName = "plane"
ghenv.Component.Params.Input[2].Description = "Plane in which to draw a rectangle"

ghenv.Component.Params.Input[3].NickName = "name"
ghenv.Component.Params.Input[3].Description = "Name of your rectangle"

#-----------output---------------
ghenv.Component.Params.Output[1].NickName = "area" #mind that output parameters start at index 1
ghenv.Component.Params.Output[1].Description = "Computed area of the rectangle"

ghenv.Component.Params.Output[2].NickName = "geom"
ghenv.Component.Params.Output[2].Description = "Geometry of the rectangle"

#----errors and warnings---------
e = gh.GH_RuntimeMessageLevel.Error
w = gh.GH_RuntimeMessageLevel.Warning

#-----------classes--------------
class Rectangle:
    ALL = dict() #a keeper of all Rectangle class instances
    
    def __init__(self, width, length, plane, name):
        self.width = width
        self.length = length
        self.name = name
        self.color = (255, 0, 46)
        
        self.geom = RG.Rectangle3d(plane, width, length)
        self.area = self.geom.Area
        
        self.ALL[name] = self
        
#-------------functions----------
def main(w, l, pl, n):
    
    rec = Rectangle(w, l, pl, n)
    
    return rec.area, rec.geom
    
#---------exceptions------------
if width == 0 or length == 0:
    ghenv.Component.AddRuntimeMessage(w, "Your rectangle is just a line")
    
if width < 0 or length < 0:
    ghenv.Component.AddRuntimeMessage(e, "Width and length must be positive numbers")
else:
    area, geom = main(width, length, plane, name)
    
#-------------sticky-------------

sc.sticky["Rectangle"] = Rectangle
# ---------- end rectangle_py ----------
panel = Panel(rectangle_py.area)
panel_2 = Panel(rectangle_py.geom)
rerectangle_py = Author_ReRectanglePy(HAND=rectangle_py.HAND)  # -> out, area, geom, name, color
# ---------- rerectangle_py: Python ----------
"""
This component reproduces a rectangle
"""

version = 'v.0.0.1'                             #indicate version number
ghenv.Component.Message = version
ghenv.Component.Name = "Author_ReRectangle.py"  #indicate authore
ghenv.Component.NickName = "ReRectangle.py"     #give a short name for the function

#-----------import---------------
import Rhino.Geometry as RG
import scriptcontext as sc

#-----------output---------------
ghenv.Component.Params.Output[1].NickName = "area" #mind that output parameters start at index 1
ghenv.Component.Params.Output[1].Description = "Computed area of the rectangle"

ghenv.Component.Params.Output[2].NickName = "geom"
ghenv.Component.Params.Output[2].Description = "Geometry of the rectangle"

ghenv.Component.Params.Output[3].NickName = "name"
ghenv.Component.Params.Output[3].Description = "Name of the rectangle"

ghenv.Component.Params.Output[4].NickName = "color"
ghenv.Component.Params.Output[4].Description = "Color of the rectangle"


    
#-------------sticky-------------

Rectangle = sc.sticky["Rectangle"]

area = [rec.area for rec in Rectangle.ALL.values()]
geom = [rec.geom for rec in Rectangle.ALL.values()]
name = [rec.name for rec in Rectangle.ALL.values()]
color = [rec.color for rec in Rectangle.ALL.values()]
# ---------- end rerectangle_py ----------
