# Grasshopper definition ReadPointCloudviaGUID.gh (Grasshopper 1.0.7)
# Copyright: All rights reserved

id = Guid(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)
vb = VBScript(id=id)  # -> out, P, N, C; inputs id: Guid
# ---------- vb: VB usings ----------
Imports System.IO
Imports System.Linq
Imports System.Data
Imports System.Drawing
Imports System.Reflection
Imports System.Windows.Forms
Imports System.Xml
Imports System.Xml.Linq
Imports Microsoft.VisualBasic
Imports System.Runtime.InteropServices

Imports Rhino.DocObjects
Imports Rhino.Collections
Imports GH_IO
Imports GH_IO.Serialization
# ---------- vb: VB ----------
    Dim obj As Object = RhinoDocument.Objects.Find(id)
    If obj Is Nothing Then
      Return
    End If

    Dim cloudObject As Rhino.DocObjects.PointCloudObject = TryCast(obj, Rhino.DocObjects.PointCloudObject)
    If cloudObject Is Nothing Then
      Return
    End If
    Dim cloud As PointCloud = cloudObject.PointCloudGeometry

    Dim points As New List(Of Point3d)()
    Dim normals As List(Of Vector3d) = Nothing
    Dim colours As List(Of Color) = Nothing

    If cloud.ContainsNormals Then
      normals = New List(Of Vector3d)()
    End If
    If cloud.ContainsColors Then
      colours = New List(Of Color)()
    End If

    For Each item As PointCloudItem In cloud
      points.Add(item.Location)

      If normals IsNot Nothing Then
        normals.Add(item.Normal)
      End If
      If colours IsNot Nothing Then
        colours.Add(item.Color)
      End If
    Next

    P = points
    N = normals
    C = colours
# ---------- end vb ----------
python = GhPythonScript(id=id)  # -> out, a
# ---------- python: Python ----------
__author__ = "pnourian"
__version__ = "2020.08.24"

import Rhino as rh
a=rh.RhinoDoc.ActiveDoc.Objects.Find(id).PointCloudGeometry
# ---------- end python ----------
c_script = CSharpScript(id=id)  # -> out, P, N, C; inputs id: Guid
# ---------- c_script: C# usings ----------
using System.IO;
using System.Linq;
using System.Data;
using System.Drawing;
using System.Reflection;
using System.Windows.Forms;
using System.Xml;
using System.Xml.Linq;
using System.Runtime.InteropServices;

using Rhino.DocObjects;
using Rhino.Collections;
using GH_IO;
using GH_IO.Serialization;
# ---------- c_script: C# ----------
    object obj = RhinoDocument.Objects.Find(id);//in Python Rhino.RhinoDoc.ActiveDoc.Objects.Find(id)
    if (obj == null)
      return;

    Rhino.DocObjects.PointCloudObject cloudObject = obj as Rhino.DocObjects.PointCloudObject;
    if (cloudObject == null)
      return;
    PointCloud cloud = cloudObject.PointCloudGeometry;

    List<Point3d> points = new List<Point3d>();
    List<Vector3d> normals = null;
    List<Color> colours = null;

    if (cloud.ContainsNormals)
      normals = new List<Vector3d>();
    if (cloud.ContainsColors)
      colours = new List<Color>();

    foreach (PointCloudItem item in cloud)
    {
      points.Add(item.Location);

      if (normals != null)
        normals.Add(item.Normal);
      if (colours != null)
        colours.Add(item.Color);
    }

    P = points;
    N = normals;
    C = colours;
# ---------- end c_script ----------
panel = Panel(c_script.out)
