# Grasshopper definition SurfaceMeshFromPoints.gh (Grasshopper 0.9.76)
# Copyright: All rights reserved

recgrid = Rectangular(Plane=PlaneXY(0.5174227839, -113.5622673, 0), SizeX=1, SizeY=2, ExtentX=10, ExtentY=5)  # -> Cells, Points
pt = Point(flatten(recgrid.Points))
points = PointList(Points=pt, Size=Slider(0.8, range=0..1))
c_script = CSharpScript(P=pt, U=Slider(8, range=0..10), V=Slider(5, range=0..10))  # -> out, A; inputs P: list of Point3d, U: Int32, V: Int32, C: list of Color
# ---------- c_script: C# ----------
    Mesh M = new Mesh();
    M.Vertices.AddVertices(P);
    if(C != null){M.VertexColors.AppendColors(C.ToArray());}


    for(int i = 0;i < U ;i++)
      for(int j = 0;j < V;j++)
      {
        {
          int n0,n1,n2,n3;
          n0 = i * (V + 1) + j;
          Print(n0.ToString());
          n1 = n0 + 1;
          n2 = n1 + V + 1;
          n3 = n2 - 1;
          MeshFace face = new MeshFace(n0, n1, n2, n3);
          //Print(string.Join(",", new string[]{face.A.ToString(), face.B.ToString(), face.C.ToString(), face.D.ToString()}));
          M.Faces.AddFace(face);
        }
      }
    A = M;
# ---------- end c_script ----------
mesh = Mesh(c_script.A)
medges = MeshEdges(Mesh=mesh)  # -> NakedEdges, InteriorEdges, NonManifoldEdges
