# Grasshopper definition WeldingMeshes.gh (Grasshopper 0.9.76)
# Copyright: All rights reserved

mesh = Mesh(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)
c_script = CSharpScript(x=mesh, Weld=Toggle(False))  # -> out, A, B, C, D, E, F; inputs x: Mesh, Weld: Boolean
# ---------- c_script: C# ----------
    if(Weld){x.Weld(0.6 * Math.PI);}
    A = x.Vertices;
    B = x.TopologyVertices;
    C = x.Faces;
    x.Normals.ComputeNormals();
    D = x.Normals;
    E = x.FaceNormals;
    Point3d[] faceCenters = new Point3d[x.Faces.Count];
    for(int i = 0;i < x.Faces.Count;i++){
      faceCenters[i] = x.Faces.GetFaceCenter(i);
    }
    F = faceCenters;
# ---------- end c_script ----------
panel = Panel(c_script.C)
vdisex = VectorDisplayEx(Point=c_script.F, Vector=c_script.E, Colour=RGB(0, 7, 18), Width=4)
vdis = VectorDisplay(Anchor=c_script.A, Vector=c_script.D)
panel_2 = Panel(c_script.B)
panel_3 = Panel(c_script.A)
