# Grasshopper definition postgreSQLConnection-ToGH_PZN_RSL.gh (Grasshopper 0.9.76)
# Copyright: All rights reserved
# plug-ins: SlingshotDB

# ---- group: make a suitable connection string
# Read Me: Step0: you must have installed PostgreSQL, PostGIS and Slingshot plugin for Grasshopper: http://wiki.theprovingground.org/slingshot, if you cannot manage with the latest release, I would advise to use an older version:
# 
# http://wiki.theprovingground.org/slingshot-db-download
# 
# Step1: Run PgAdmin and enter your password to enter one of your postgre databases on port 5432 for instance
# 
# Step2: In this file, toggle the boolean sitch marked in red to get connected!
# If something goes wrong, first make sure that your password, port, database name etc. are correct, the current setting only applies to my machine!
# in the likely case that the connection string of Slingshot does not work, use the patch developed by Rusne Sileryte to adjust the connection string. It could be that the driver on your machine is something different, so you will need to adjust the patch as well.
# 
# Step3: using the ODBC command and ODBC query components make your tables, store sample data and inspect it.
# 
# Pirouz Nourian p.nourian@tudelft.nl
panel = Panel("localhost")
pgstring = PostgreSQLConnectionString(
    Server=panel,
    Port="5432",
    UserID="postgres",
    Password="1234",
    Database="postgres",
    CommandTimeout="20",
    ConnnectionTimeout="5")
patch = VBScript(CString=pgstring)  # -> out, A
# ---------- patch: VB ----------
    '   Patch developed by MSc Geomatics, Rusne Sileryte, in June 2014

    Dim CSList() As  String
    CSList = Cstring.Split(";")
    CSlist(0) = "Driver={PostgreSQL ODBC Driver(UNICODE)}"
    Dim CS As String
    CS = String.Join(";", CSlist)
    A = CS
# ---------- end patch ----------

# ---- group: put some dummy data in that table / Demo dummy data
series = Series(Start=0, Step=1, Count=10)

# ---- group: an example dataset: scalar field / DataPreparation / VoxelData_Demo
M = Number([0.001516310981, 0.001731464927, 0.001891233151, 0.001970616271, 0.001961090484, 0.001874079448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])
pt = Point([Point(-21, -23, 0), Point(-18, -23, 0), Point(-15, -23, 0), Point(-12, -23, 0), Point(-9, -23, 0), Point(-6, -23, 0)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])

# ---- group: an example dataset: scalar field / DataPreparation
pdecon = Deconstruct(Point=pt)  # -> XComponent, YComponent, ZComponent
cluster = Cluster(t=M)  # -> C, R_2, G_2, B_2
dots = DotDisplay(Point=pt, Colour=cluster.C, Size=2)
Z = Number(pdecon.ZComponent)
M_2 = Number(M)
R = Integer(cluster.R_2)
G = Integer(cluster.G_2)
B = Integer(cluster.B_2)
X = Number(pdecon.XComponent)
Y = Number(pdecon.YComponent)
merge = Merge(Data1=graft(X), Data2=graft(Y), Data3=graft(Z), Data4=graft(M_2), Data5=graft(R), Data6=graft(G), Data7=graft(B))
join = TextJoin(Text=merge, Join=",")  # -> flatten(Result)
voxel_data = Data(join)
format = Format(Format="({0})", Culture=127, Data0=voxel_data)
join_2 = TextJoin(Text=format, Join=",")  # -> flatten(Result)
data = Data(join_2)

# ---- group: First
toggle = BooleanToggle(False)

# ---- group: Create a table
panel_2 = Panel("tabletest")
cstring = Text(patch.A)
createtb = SQLCreateTable(TableName=panel_2, Columns="C1 INT NOT NULL , PRIMARY KEY(C1)", DropTable=False)
odbccommand = ODBCCommand(ConnectionString=cstring, ConnectToggle=toggle, Command=createtb)

# ---- group: query your data
querysfw = SQLSELECTString(Select="C1", From=panel_2, Where="C1>5")
odbc_query = ODBCQuery(ConnectString=cstring, ConnectToggle=Toggle(False), Query=querysfw, ColumnNumber=0)  # -> Exceptions, ColumnQueryResult, QueryResult

# ---- group: put some dummy data in that table
insert = SQLInsertCommand(Table=panel_2, Columns="C1", Data=series, Update=False)
odbccommand_2 = ODBCCommand(ConnectionString=cstring, ConnectToggle=Button(), Command=insert)

# ----
panel_3 = Panel(odbc_query.Exceptions)
panel_4 = Panel(odbc_query.QueryResult)
panel_5 = Panel(odbccommand_2)
panel_6 = Panel(odbccommand)

# ---- group: an example dataset: scalar field / example
txt = Text("INSERT INTO voxeltable() VALUES ()")

# ---- group: an example dataset: scalar field
# Read Me: You can create a voxel table and store this data to get started!
panel_7 = Panel(txt)
data_2 = Data(data)
fragment = TextFragment(Text=panel_7, Start=0, Count=22)
concat = Concatenate(FragmentA=fragment, FragmentB=" VALUES")
concat_2 = Concatenate(FragmentA=concat, FragmentB=data_2)
batchload_cmd = Text(concat_2)

# ==== cluster Cluster
t = ClusterInput()
t_2 = Parameter(t)
bnd = Bounds(Numbers=t_2)
dedomain = DeconstructDomain(Domain=bnd)  # -> Start, End
gradient = Gradient(
    LowerLimit=dedomain.Start,
    UpperLimit=dedomain.End,
    Parameter=t_2,
    stops=[0: RGB(234, 38, 0), 0.0342: RGB(234, 126, 0), 0.0699: RGB(254, 244, 84), 0.0942: RGB(173, 203, 249), 1: RGB(75, 107, 169)])
col = Colour(gradient)
C = ClusterOutput(gradient)
vb = VBScript(x=col)  # -> out, R, G, B; inputs x: Color
# ---------- vb: C# ----------
    R = x.R
    G = x.G
    B = x.B
# ---------- end vb ----------
R = Number(vb.R)
G = Number(vb.G)
B = Number(vb.B)
R_2 = ClusterOutput(R)
G_2 = ClusterOutput(G)
B_2 = ClusterOutput(B)
